# Dynamo graph arm_recta_pataInferior_segmentoUnico_script.dyn (Dynamo 2.6.2.15705)
# packages: Data-Shapes 2022.2.103, Structural Design 2021.1.22, Genius Loci 2021.11.10, Orchid 206.3.0.8161

o_document_activeview = Orchid.RevitProject.Common.Document.ActiveView()
code_block = CodeBlock { "Recta Pata Inferior Segmento Unico"; }
file_path = Filename("..\..\..\..\..\..\..\..\..\..\Arainco\Arainco.png")
code_block_2 = CodeBlock { "INICIAR"; "CANCELAR"; true; 430; 170; 650; }
categories_ᶜᵒⁿᵛᵉʳᵗᵉᵈ_ᵈʳᵒᵖᵈᵒʷⁿ = CodeBlock { "Seleccionar Muros a Armar"; "SELECCIONAR"; Revit.Category.ByName(["Walls","Structural Foundations"]); }
selectmodelelements_data = Custom[SelectModelElements Data](InputName=categories_ᶜᵒⁿᵛᵉʳᵗᵉᵈ_ᵈʳᵒᵖᵈᵒʷⁿ.out0, ButtonText=categories_ᶜᵒⁿᵛᵉʳᵗᵉᵈ_ᵈʳᵒᵖᵈᵒʷⁿ.out1, CategoryFilter=categories_ᶜᵒⁿᵛᵉʳᵗᵉᵈ_ᵈʳᵒᵖᵈᵒʷⁿ.out2)  # package Data-Shapes; Creates a Revit element selection input for UI.MultipleInputForm++ . Check out www.data-shapes.net for more infos!
code_block_3 = CodeBlock { "Seleccionar Cara de\nDistribucion"; "SELECCIONAR"; }
selectfaces_data = Custom[SelectFaces Data](InputName=code_block_3.out0, ButtonText=code_block_3.out1)  # package Data-Shapes; Creates a Revit face selection input for UI.MultipleInputForm++. Check out www.data-shapes.net for more infos!
code_block_4 = CodeBlock { "Seleccionar punto de Empotramiento"; "SELECCIONAR"; }
selectfaces_data_2 = Custom[SelectFaces Data](InputName=code_block_4.out0, ButtonText=code_block_4.out1)
code_block_5 = CodeBlock { "Datos de Armadura"; }
code_block_6 = CodeBlock { "Diametro"; }
element_types_ᶜᵒⁿᵛᵉʳᵗᵉᵈ_ᵈʳᵒᵖᵈᵒʷⁿ = CodeBlock { DSCore.Types.FindTypeByNameInAssembly("RebarBarType", "RevitAPI"); }
all_elements_of_type = ElementsOfType(element_type=element_types_ᶜᵒⁿᵛᵉʳᵗᵉᵈ_ᵈʳᵒᵖᵈᵒʷⁿ)
code_block_7 = CodeBlock(t5=all_elements_of_type)
# ---------- code_block_7.designscript (8 lines) ----------
t4 = t5;
t1 = t4;
num1 = Properties.RebarDiameter(t1);
t2 = DSCore.List.SortByKey(t1, num1);
t3 = Dictionary.ValueAtKey(t2, "sorted list");
str1 = Revit.Elements.Element.Name(t3);
0;
false;
# ----------------------------------------
dropdown_data = Custom[DropDown Data](InputName=code_block_6, Keys=code_block_7.str1, Values=code_block_7.t3, DefaultValueIndex=code_block_7.out6, Sorted_optional=code_block_7.out7)  # package Data-Shapes; Create data for DropDown input in UI.MultiInputForm ++ . Check out www.data-shapes.net for more infos.
code_block_8 = CodeBlock { "Cantidad de Barras"; "2"; true; }
textbox_data = Custom[TextBox Data](InputName=code_block_8.out0, DefaultText=code_block_8.out1, IsNumberEntry=code_block_8.out2)  # package Data-Shapes; Create Data for TextBox input in UI.MultipleInputForm ++ . Check out www.data-shapes.net for more informations
code_block_9 = CodeBlock { "Capa"; ["1ª Capa", "2ª Capa", "3ª Capa", "4ª Capa", "5ª Capa"]; [40, 140, 240, 340, 440]; 0; }
dropdown_data_2 = Custom[DropDown Data](InputName=code_block_9.out0, Keys=code_block_9.out1, Values=code_block_9.out2, DefaultValueIndex=code_block_9.out3)
list_create = List.Create(item0=dropdown_data, item1=textbox_data, item2=dropdown_data_2)
inputgroup_data = Custom[InputGroup Data](GroupTitle=code_block_5, Inputs=list_create)  # package Data-Shapes; Creates a group of inputs for UI.MultipleInputForm ++ . Check out www.data-shapes.net for more infos !
list_create_2 = List.Create(item0=selectmodelelements_data, item1=selectfaces_data, item2=selectfaces_data_2, item3=inputgroup_data)
multipleinputform = Custom[MultipleInputForm ++](Description_optional=code_block, Logo_optional=file_path, ButtonText_optional=code_block_2.out0, Inputs=list_create_2, Toggle=code_block_2.out2, CancelButtonText_optional=code_block_2.out1, MaxHeight_optional=code_block_2.out5, Width_optional=code_block_2.out3, LabelWidth_optional=code_block_2.out4)  # package Data-Shapes; Create a form with multiple inputs. see www.data-shapes.net for tutorials and infos!
code_block_10 = CodeBlock(l=multipleinputform.User_Inputs)
# ---------- code_block_10.designscript (12 lines) ----------
l;
[Imperative]
{
	if (l == null)
	{
		return = [[],[],[],[],[],[],[]];
	}
	else
	{
		return = l;
	}
};
# ----------------------------------------
code_block_11 = CodeBlock(x=code_block_10.out1) { x; }
code_block_12 = CodeBlock(muros=code_block_11) { muros[0]; }
solidos_de_muros_seleccionados = CodeBlock(muros=code_block_12)
# ---------- solidos_de_muros_seleccionados.designscript (6 lines) ----------
elem_geom = Revit.Elements.Element.Geometry(muros);
elem_geom_flat = DSCore.List.Flatten(elem_geom, -1);
centroid_geom = Autodesk.Solid.Centroid(elem_geom_flat);
plane = Autodesk.Plane.ByOriginNormal(centroid_geom, Autodesk.Vector.ZAxis());
elem_geom_scaled = Autodesk.Geometry.Scale(elem_geom_flat, plane, 1, 5, 1);
elem_geom_union = Autodesk.Solid.ByUnion(elem_geom_scaled);
# ----------------------------------------
to_empty_list = Python(IN[0]=solidos_de_muros_seleccionados.elem_geom_union)
# ---------- to_empty_list.python (9 lines) ----------
var = IN[0]
lst = None

if var == lst:
	x = [] 
else:
	x = var

OUT = x
# ----------------------------------------
code_block_13 = CodeBlock(distribucion=code_block_11) { distribucion[1]; }
code_block_14 = CodeBlock(capa=code_block_11) { capa[5]; }
code_block_15 = CodeBlock(t3=code_block_13, t4=code_block_14)
# ---------- code_block_15.designscript (9 lines) ----------
t2 = t3;
t1 = t2;
vector1 = Autodesk.Surface.NormalAtParameter(t1, 0.5, 0.5);
vector2 = Autodesk.Vector.Reverse(vector1);
surface = Autodesk.Geometry.Translate(t3, vector2, t4)[0];
point = Autodesk.Surface.PointAtParameter(surface, 0.5, 0.5);
surface_normal = Autodesk.Surface.NormalAtParameter(surface, 0.5, 0.5);
plane = Autodesk.Plane.ByOriginNormal(point, Autodesk.Vector.ZAxis());
scale_surface = Autodesk.Geometry.Scale(surface, plane, 1, 1, 100);
# ----------------------------------------
code_block_16 = CodeBlock(solid=to_empty_list, surface_cut=code_block_15.scale_surface)
# ---------- code_block_16.designscript (13 lines) ----------
solid;
surface_cut;

geometry1 = Autodesk.Geometry.Intersect(solid, surface_cut);
point1 = Autodesk.Surface.PointAtParameter(geometry1, 0.5, 0.5);
vector1 = Autodesk.Vector.ZAxis();
geometry2 = Autodesk.Geometry.Rotate(geometry1, point1, vector1, 90);
geometry11 = geometry2;
point11 = Autodesk.Surface.PointAtParameter(geometry11, 0.5, 0.5);
vector11 = Autodesk.Surface.NormalAtPoint(geometry11, point11);
plane1 = Autodesk.Plane.ByOriginNormal(point11, vector11);
geometry3 = Autodesk.Geometry.Scale(geometry2, plane1, 1, 15, 1);
geometry4 = Autodesk.Geometry.Intersect(geometry1, plane1)[0];
# ----------------------------------------
control_de_flujo = Python(IN[0]=code_block_16.geometry4)  # same code as to_empty_list
code_block_17 = CodeBlock(t1=control_de_flujo)
# ---------- code_block_17.designscript (4 lines) ----------
vector1 = Autodesk.Vector.ZAxis();
vector2 = StructuralDesign.Vector.ByLine(t1);
bool1 = Autodesk.Vector.IsAlmostEqualTo(vector1, vector2);
curve1 = Autodesk.Curve.Reverse(t1);
# ----------------------------------------
if_ = If(test=code_block_17.bool1, true=code_block_17.curve1, false=control_de_flujo)
reverse = Curve.Reverse(curve=if_)
code_block_18 = CodeBlock { -20; }
extendEnd = Curve.ExtendEnd(curve=reverse, distance=code_block_18)
normal_para_posicionamiento_de = Python(IN[0]=code_block_16.vector11)  # "Normal para Posicionamiento de Barra"
# ---------- normal_para_posicionamiento_de.python (9 lines) ----------
var = IN[0]
lst = []

if var == lst:
	x = [] 
else:
	x = var[0]

OUT = x
# ----------------------------------------
code_block_19 = CodeBlock(muros=code_block_11) { muros[0]; }
code_block_20 = CodeBlock(coleccion=code_block_19)
# ---------- code_block_20.designscript (8 lines) ----------
coleccion;
category = Revit.Elements.Element.GetCategory(coleccion);
category_name = Revit.Category.Name(category);
mask = category_name == "Walls";
element = DSCore.List.FilterByBoolMask(coleccion, mask)["in"][0];
element_type = Revit.Elements.Element.GetParameterValueByName(element, "Type");
element_width = Revit.Elements.Element.GetParameterValueByName(element_type, "Width");
(element_width / 2) - 40;
# ----------------------------------------
translate = Geometry.Translate(geometry=extendEnd, direction=normal_para_posicionamiento_de, distance=code_block_20.out7, lacing=Longest)
code_block_21 = CodeBlock { -50; }
extendStart = Curve.ExtendStart(curve=translate, distance=code_block_21)
code_block_22 = CodeBlock(empalme=code_block_11) { empalme[2]; }
control_de_flujo_2 = Python(IN[0]=code_block_22)  # same code as normal_para_posicionamiento_de
plano_para_empotramiento = CodeBlock(t1=control_de_flujo_2)
# ---------- plano_para_empotramiento.designscript (3 lines) ----------
point1 = Autodesk.Surface.PointAtParameter(t1, 0.5, 0.5);
vector1 = Autodesk.Surface.NormalAtPoint(t1, point1);
plane1 = Autodesk.Plane.ByOriginNormal(point1, vector1);
# ----------------------------------------
split = Geometry.Split(geometry=extendStart, other=plano_para_empotramiento.plane1)
control_de_flujo_3 = Python(IN[0]=split)  # same code as normal_para_posicionamiento_de
code_block_23 = CodeBlock(tip_barra=code_block_11) { tip_barra[3]; }
traslapo_armadura = CodeBlock(rebar=code_block_23)
# ---------- traslapo_armadura.designscript (5 lines) ----------
diametro_barra = Strings.ToString(Properties.RebarDiameter(rebar),"");
key = ["8","10","12","16","18","22","25","28","32","36"];
val = [570, 710, 860, 1140, 1290, 1960, 2230, 2500, 2850, 3210];
dict_traslapo = Dictionary.ByKeysValues(key, val);
t3 = Dictionary.ValueAtKey(dict_traslapo, diametro_barra);
# ----------------------------------------
extendEnd_2 = Curve.ExtendEnd(curve=control_de_flujo_3, distance=traslapo_armadura.t3)
code_block_24 = CodeBlock(tip_barra=code_block_11) { tip_barra[3]; }
element_types_ᶜᵒⁿᵛᵉʳᵗᵉᵈ_ᵈʳᵒᵖᵈᵒʷⁿ_2 = CodeBlock { DSCore.Types.FindTypeByNameInAssembly("RebarHookType", "RevitAPI"); }
all_elements_of_type_2 = ElementsOfType(element_type=element_types_ᶜᵒⁿᵛᵉʳᵗᵉᵈ_ᵈʳᵒᵖᵈᵒʷⁿ_2)
rebar_hook_type_at_start = CodeBlock(t3=all_elements_of_type_2)
# ---------- rebar_hook_type_at_start.designscript (5 lines) ----------
t1 = t3;
str2 = Revit.Elements.Element.Name(t1);
t2 = str2 == "Standard - 90 deg.";
t4 = DSCore.List.FilterByBoolMask(t3, t2);
t5 = Dictionary.ValueAtKey(t4, "in");
# ----------------------------------------
reverse_2 = Vector.Reverse(vector=normal_para_posicionamiento_de)
code_block_25 = CodeBlock(curves=extendEnd_2, rebarBarType=code_block_24, startHookType=rebar_hook_type_at_start.t5, hostElement=code_block_20.element, vector=reverse_2)
# ---------- code_block_25.designscript (18 lines) ----------
//curves
curves;
//rebarStyle
"Standard";
//rebarBarType
rebarBarType;
//startHookType
startHookType;
//endHookType
null;
//startHookOrientation
"Left";
//endtHookOrientation
"Left";
//hostElement
hostElement;
//vector
vector;
# ----------------------------------------
fromCurves = StructuralDesign.Rebar.Create.FromCurves(curves=code_block_25.curves@L1, rebarStyle=code_block_25.out1@L1, rebarBarType=code_block_25.rebarBarType@L1, startHookType=code_block_25.startHookType@L1, endHookType=code_block_25.out4@L1, startHookOrientation=code_block_25.out5@L1, endHookOrientation=code_block_25.out6@L1, hostElement=code_block_25.hostElement@L1, vector=code_block_25.vector@L1, lacing=Longest)
element_types_ᶜᵒⁿᵛᵉʳᵗᵉᵈ_ᵈʳᵒᵖᵈᵒʷⁿ_3 = CodeBlock { DSCore.Types.FindTypeByNameInAssembly("RebarShape", "RevitAPI"); }
all_elements_of_type_3 = ElementsOfType(element_type=element_types_ᶜᵒⁿᵛᵉʳᵗᵉᵈ_ᵈʳᵒᵖᵈᵒʷⁿ_3)
code_block_26 = CodeBlock(t1=all_elements_of_type_3)
# ---------- code_block_26.designscript (5 lines) ----------
"Shape";
str2 = Revit.Elements.Element.Name(t1);
t2 = str2 == "R_S_01";
t3 = DSCore.List.FilterByBoolMask(t1, t2);
t4 = Dictionary.ValueAtKey(t3, "in");
# ----------------------------------------
setParameterByName = Element.SetParameterByName(element=fromCurves, parameterName=code_block_26.out0, value=code_block_26.t4, lacing=Longest)
code_block_27 = CodeBlock { "Capa"; }
code_block_28 = CodeBlock(capa=code_block_11) { capa[5]; }
string_from_object = FromObject(obj=code_block_28)
numero_de_capa = CodeBlock(capa=string_from_object)
# ---------- numero_de_capa.designscript (4 lines) ----------
key = ["40", "140", "240", "340", "440"];
val = ["1", "2", "3", "4", "5"];
dict_capa = Dictionary.ByKeysValues(key, val);
t3 = Dictionary.ValueAtKey(dict_capa, capa);
# ----------------------------------------
setParameterByName_2 = Element.SetParameterByName(element=setParameterByName, parameterName=code_block_27, value=numero_de_capa.t3)
code_block_29 = CodeBlock { "Override Hook Lengths"; 1; }
setParameterByName_3 = Element.SetParameterByName(element=setParameterByName_2, parameterName=code_block_29.out0, value=code_block_29.out1)
desplazamiento_barra = CodeBlock(t2=code_block_20.element)
# ---------- desplazamiento_barra.designscript (3 lines) ----------
t1 = Revit.Elements.Element.GetParameterValueByName(t2, "Type");
t3 = Revit.Elements.Element.GetParameterValueByName(t1, "Width");
t4 = t3 - 80;
# ----------------------------------------
code_block_30 = CodeBlock(cant_barra=code_block_11) { cant_barra[4]; }
setLayoutAsFixedNumber = StructuralDesign.Rebar.Layout.SetLayoutAsFixedNumber(rebar=setParameterByName_3, arrayLength=desplazamiento_barra.t4, numberOfBarPositions=code_block_30)
code_block_31 = CodeBlock(capa=code_block_11) { capa[5]; }
string_from_object_2 = FromObject(obj=code_block_31)
code_block_32 = CodeBlock(t3=string_from_object_2)
# ---------- code_block_32.designscript (4 lines) ----------
t1 = ["40", "140", "240", "340", "440"];
t2 = [0.1, 0.2, 0.3, 0.4, 0.5];
dictionary1 = Dictionary.ByKeysValues(t1, t2);
t4 = Dictionary.ValueAtKey(dictionary1, t3);
# ----------------------------------------
code_block_33 = CodeBlock(distribucion=code_block_11) { distribucion[1]; }
plano_para_ajustar_tag = CodeBlock(t2=code_block_33)
# ---------- plano_para_ajustar_tag.designscript (6 lines) ----------
t1 = t2;
vector1 = Autodesk.Surface.NormalAtParameter(t1, 0.5, 0.5);
geometry1 = Autodesk.Geometry.Translate(t1, vector1, 900);
point1 = Autodesk.Surface.PointAtParameter(geometry1, 0.5, 0.5);
vector2 = Autodesk.Surface.NormalAtPoint(geometry1, point1);
plane1 = Autodesk.Plane.ByOriginNormal(point1, vector2);
# ----------------------------------------
code_block_34 = CodeBlock(element2=setLayoutAsFixedNumber, des_anotacion=code_block_32.t4, plane1=plano_para_ajustar_tag.plane1)
# ---------- code_block_34.designscript (6 lines) ----------
element1 = element2;
curve1 = Properties.RebarCenterlineCurves(element1, false, true, true, true, 0);
t1 = DSCore.List.Flatten(curve1, -1);
point1 = Autodesk.Curve.PointAtParameter(t1, des_anotacion);
t2 = DSCore.List.Flatten(point1, -1);
point2 = Points.PullOntoPlane(t2, plane1);
# ----------------------------------------
code_block_35 = CodeBlock()
# ---------- code_block_35.designscript (4 lines) ----------
family1 = Revit.Family.ByName("EST_A_STRUCTURAL REBAR TAG_STANDAR");
familytype1 = Revit.Elements.FamilyType.ByFamilyAndName(family1, "R_S_01");
true;
true;
# ----------------------------------------
create_tag = Custom[Create Tag](view=o_document_activeview@L1, element=setLayoutAsFixedNumber@L1, TagLocation=code_block_34.t2@L1, TagType=code_block_35.familytype1@L1, addLeader=code_block_35.out2@L1, RunIt=code_block_35.out3@L1, lacing=Longest)  # package Genius Loci; Works only in Revit 2018 and later. Creates a tag at a given location, of given type and in a supplied view. The node also works with Linked Elements (except space and area), Multi Category tag and Material Tag. Based on an archilab node
flatten = List.Flatten(list=create_tag)
tag_setlocation = Custom[Tag SetLocation](tag=flatten, location=code_block_34.point2)  # package Genius Loci; Moves the head of the tag to the given location point.
